% Simulink data dictionary StateMachine.sldd

ContactorState = enum(DefaultValue="Faulted", StorageType="uint8", AddClassNameToEnumNames=true)
  Faulted = 0
  Close = 1
  Open = 2

VehicleState = enum(DefaultValue="Off", StorageType="uint8", AddClassNameToEnumNames=true)
  Off = 0
  StartDelay = 1
  PrechargeReady = 2
  Precharge = 3
  PrechargeTimeout = 4
  PrechargeComplete = 5
  Standby = 6
  ReadyToMove = 7
  Faulted = 8